# Grasshopper definition LLM_talk_grasshopper.gh (Grasshopper 1.0.8)

panel = Panel("sql/building_panels-database1.db\"")
py3 = Python3Script(input_text="what is the recommended WWR for Barcelona? ", run=Toggle(True))  # -> out, orientations, values
# ---------- py3: Python ----------
#r: requests
import requests
import re
import json

url = 'http://localhost:6000/llm_call'
payload = {'input': input_text}


out = None
orientations = []
values = []
def parse_json_values(raw: str) -> dict:
    # look for the first {...} substring
    m = re.search(r"\{[^}]+\}", raw)
    if not m:
        return {}
    substr = m.group(0)
    try:
        return json.loads(substr)
    except json.JSONDecodeError:
        # if it's Python-style quotes (single quotes), convert to double
        py_literal = substr.replace("'", '"')
        try:
            return json.loads(py_literal)
        except json.JSONDecodeError:
            return {}

response = requests.post(url, json=payload)
if response.status_code == 200:
    data    = response.json()
    out     = data.get("response","")
    raw     = data.get("json_values","")
    print(out)
    wwr_json = parse_json_values(raw)

    # now safe to do:
    orientations = list(wwr_json.keys())
    values       = [wwr_json[k] for k in orientations]

    print("Orientations:", orientations)
    print("Values:      ", values)
else:
    print("Failed to connect:", response.status_code)
# ---------- end py3 ----------
panel_2 = Panel(py3.values)
panel_3 = Panel(py3.orientations)
panel_4 = Panel(py3.out)
